# Dynamo graph hack hotel csv out.dyn (Dynamo 1.2.1.3083)

categories = Categories("ElectricalFixtures")
all_elements_of_category = ElementsOfCategory(categories)
getLocation = Element.GetLocation(all_elements_of_category)
id = Element.Id(all_elements_of_category)
getType = FamilyInstance.GetType(all_elements_of_category)
name = Element.Name(getType)
getHost = FamilyInstance.GetHost(all_elements_of_category)
id_2 = Element.Id(getHost)
categories_2 = Categories("Walls")
all_elements_of_category_2 = ElementsOfCategory(categories_2)
id_3 = Element.Id(all_elements_of_category_2)
watch = Watch(id_3)
geometry = Element.Geometry(all_elements_of_category_2)
watch_2 = Watch(geometry)
watch_3 = Watch(all_elements_of_category_2)
file_path = Filename(".\text.csv")
categories_3 = Categories("Furniture")
all_elements_of_category_3 = ElementsOfCategory(categories_3)
id_4 = Element.Id(all_elements_of_category_3)
getType_2 = FamilyInstance.GetType(all_elements_of_category_3)
name_2 = Element.Name(getType_2)
getLocation_2 = Element.GetLocation(all_elements_of_category_3)
X = Point.X(getLocation_2)
Y = Point.Y(getLocation_2)
Z = Point.Z(getLocation_2)
create = List.Create(id_4, name_2, X, Y, Z)
transpose = List.Transpose(create)
writeToFile = CSV.WriteToFile(file_path, transpose)
