# Dynamo graph hack hotel export.dyn (Dynamo 1.2.1.3083)

flux_project = ProjectsNodeModel()
flow_control = FlowControlNodeModel()
categories = Categories("Walls")
all_elements_of_category = ElementsOfCategory(categories)
geometry = Element.Geometry(all_elements_of_category)
send_to_flux = ToFluxNodeModel(flux_project, flow_control, geometry)
id = Element.Id(all_elements_of_category)
send_to_flux_2 = ToFluxNodeModel(flux_project, flow_control, id)
send_to_flux_3 = ToFluxNodeModel(flux_project, flow_control, id)
categories_2 = Categories("Furniture")
all_elements_of_category_2 = ElementsOfCategory(categories_2)
getType = FamilyInstance.GetType(all_elements_of_category_2)
name = Element.Name(getType)
send_to_flux_4 = ToFluxNodeModel(flux_project, flow_control, name)
id_2 = Element.Id(all_elements_of_category_2)
send_to_flux_5 = ToFluxNodeModel(flux_project, flow_control, id_2)
getLocation = Element.GetLocation(all_elements_of_category_2)
send_to_flux_6 = ToFluxNodeModel(flux_project, flow_control, getLocation)
categories_3 = Categories("ElectricalFixtures")
all_elements_of_category_3 = ElementsOfCategory(categories_3)
getLocation_2 = Element.GetLocation(all_elements_of_category_3)
send_to_flux_7 = ToFluxNodeModel(flux_project, flow_control, getLocation_2)
id_3 = Element.Id(all_elements_of_category_3)
send_to_flux_8 = ToFluxNodeModel(flux_project, flow_control, id_3)
getType_2 = FamilyInstance.GetType(all_elements_of_category_3)
name_2 = Element.Name(getType_2)
send_to_flux_9 = ToFluxNodeModel(flux_project, flow_control, name_2)
getHost = FamilyInstance.GetHost(all_elements_of_category_3)
id_4 = Element.Id(getHost)
send_to_flux_10 = ToFluxNodeModel(flux_project, flow_control, id_4)
watch = Watch(id)
watch_2 = Watch(geometry)
