# Dynamo graph hack hotel import.dyn (Dynamo 1.2.1.3083)

file_path = Filename(".\textb.csv")
fromPath = FileObject(file_path)  # "File.FromPath"
readFromFile = CSV.ReadFromFile(fromPath)
code_block = CodeBlock { 0; 1; 2; 3; 4; }
getItemAtIndex = List.GetItemAtIndex(list=readFromFile@L2, index=code_block.out0)
element = Custom[Id.Element](Id_s=getItemAtIndex)  # Get the Element for this element id.
getItemAtIndex_2 = List.GetItemAtIndex(list=readFromFile@L2, index=code_block.out2)
getItemAtIndex_3 = List.GetItemAtIndex(list=readFromFile@L2, index=code_block.out3)
getItemAtIndex_4 = List.GetItemAtIndex(list=readFromFile@L2, index=code_block.out4)
byCoordinates = Point.ByCoordinates(x=getItemAtIndex_2, y=getItemAtIndex_3, z=getItemAtIndex_4)
setLocation = Element.SetLocation(element, byCoordinates)
getItemAtIndex_5 = List.GetItemAtIndex(list=readFromFile@L2, index=code_block.out1)
byName = FamilyType.ByName(getItemAtIndex_5)
